# Grasshopper definition p3 final.gh (Grasshopper 1.0.5)
# plug-ins: Agent, MetaHopper, ExcelReadWrite

# ----
# pleasure block
number_slider = Slider(60, range=0..100)
box = CenterBox(
    Base=PlaneXY(0, 0, 0),
    X=expr("x/2", number_slider),
    Y=expr("x/2", Slider(50, range=0..100)),
    Z=expr("x/2", Slider(25, range=0..100)))
debrep = DeconstructBrep(Brep=box)  # -> Faces, Edges, Vertices
pipe = Pipe(Curve=debrep.Edges, Radius=Slider(0.1, range=0..1), Caps=0)
preview = CustomPreview(Geometry=pipe, Material=ColourSwatch(SwatchColor=RGB(255, 255, 255)))

panel = Panel("d27:d39")
path = FilePath("H:\tokyo\design\pleasure block 2,3\3th pleasure block.xlsx")
merge = Merge(Data1="a27:a39", Data2="b27:b39", Data3="c27:c39", Data5="e27:e39", Data6="f27:f39", Data7="g27:g39")
exdread = ExcelDynamicRead(ExcelFile=path, Connect=Toggle(True), SheetNum=Slider(1, range=0..1), DataRange=merge)  # -> DataOutput, Message
panel_2 = Panel(exdread.DataOutput)
data = Data(Slider(1800, range=0..1800))
number_slider_2 = Slider(4, range=0..10)

# ----
# café
cluster = Cluster(L=exdread.DataOutput, i=Slider(4, range=0..10))  # -> program_neme, all_output, number_of_users, weight
setscribble = SetScribbleProperties(Scribble=null, ScribbleText=cluster.program_neme, ScribbleSize=45)

# ----
# IT manager
cluster_2 = Cluster(L=exdread.DataOutput, i=Slider(5, range=0..10))  # -> program_neme, all_output, number_of_users, weight
setscribble_2 = SetScribbleProperties(Scribble=null, ScribbleText=cluster_2.program_neme, ScribbleSize=45)

# ----
# pre.f.space
cluster_3 = Cluster(L=exdread.DataOutput, i=1)  # -> program_neme, all_output, number_of_users, weight
setscribble_3 = SetScribbleProperties(Scribble=null, ScribbleText=cluster_3.program_neme, ScribbleSize=45)

# ----
# meeting rooms
cluster_4 = Cluster(L=exdread.DataOutput, i=0)  # -> program_neme, all_output, number_of_users, weight
setscribble_4 = SetScribbleProperties(Scribble=null, ScribbleText=cluster_4.program_neme, ScribbleSize=45)

# ----
# engineering
cluster_5 = Cluster(L=exdread.DataOutput, i=Slider(6, range=0..10))  # -> program_neme, all_output, number_of_users, weight
setscribble_5 = SetScribbleProperties(Scribble=null, ScribbleText=cluster_5.program_neme, ScribbleSize=45)

# ----
# shops
cluster_6 = Cluster(L=exdread.DataOutput, i=3)  # -> program_neme, all_output, number_of_users, weight
setscribble_6 = SetScribbleProperties(Scribble=null, ScribbleText=cluster_6.program_neme, ScribbleSize=45)

# ----
# toilets
cluster_7 = Cluster(L=exdread.DataOutput, i=2)  # -> program_neme, all_output, number_of_users, weight
setscribble_7 = SetScribbleProperties(Scribble=null, ScribbleText=cluster_7.program_neme, ScribbleSize=45)

addition = Addition(A=cluster_5.number_of_users, B=Slider(27, range=0..100))
timer = Timer(
    TimerInterval=10000,
    Target=[engine_2, system_2, engine, system, engine_4, system_4, engine_5, system_5, system_7, engine_7, engine_3, system_3, engine_6, system_6])
toggle = BooleanToggle(True)
number_slider_3 = Slider(0.2, range=0..1)
number_slider_4 = Slider(0.5, range=0..1)
cluster_8 = Cluster_2(A=cluster_7.weight)
cluster_9 = Cluster_4(A=cluster_4.weight)
cluster_10 = Cluster_2(A=cluster_3.weight)
number_slider_5 = Slider(0.09, range=0..1)
number_slider_6 = Slider(0.2, range=0..1)
cluster_11 = Cluster_5()

data_2 = Data(cluster.number_of_users)
data_3 = Data(box)
pop3d = Populate3D(Region=data_3, Count=data_2, Seed=1)
vec = VectorXYZ(XComponent=0, YComponent=0, ZComponent=0)  # -> Vector, Length
particle = ConstructParticle(
    UpDirection=Vector(0, 0, 1),
    Acceleration=Vector(0, 0, 0),
    Lifespan=data,
    Mass=cluster.weight,
    BodySize=1,
    HistoryLength=1)
ptemit = PointEmitter(
    ContinuousFlow=True,
    CreationRate=1,
    NumberOfQuelea=data_2,
    MinimumInitialVelocity=vec.Vector,
    MaximumInitialVelocity=vec.Vector,
    Point=pop3d)
agent = ConstructAgent(ParticleQueleaSettings=particle, MaxSpeed=0.5, MaxForce=0.1, VisionRadius=Slider(35, range=0..100), VisionAngle=360)
aaboxenv = AxisAlignedBoxEnvironment(Box=data_3)
system = System(QueleaSettings=agent, Emitters=ptemit, Environment=aaboxenv)  # -> System, Quelea, QueleaNetwork
division = Division(A=cluster.weight, B=10)
neighbors = GetNeighborsInRadius(AgentQuelea=system.Quelea, QueleaNetwork=system.QueleaNetwork, VisionRadiusMultiplier=1, VisionAngleMultiplier=1)
engine = Engine(Reset=toggle, System=system.System)
departicle = DeconstructParticle(ParticleQuelea=system.Quelea)  # -> Position, Velocity, Acceleration, Lifespan, SurfacePosition, SurfaceVelocity, SurfaceAcceleration
pt = Point(departicle.Position)
cohese = CoheseForce(Apply=True, WeightMultiplier=1, AgentQuelea=system.Quelea, QueleaNetwork=neighbors)  # -> Force, DesiredVelocity

box_maker = BoxMaker(B=pt, x=cluster.weight)
cluster_12 = Cluster_3(Q=system.Quelea, qn=system.QueleaNetwork)  # -> Q_2, qn_2
eh_ehe = EhEhe(G=box_maker)
neighbors_2 = GetNeighborsInRadius(AgentQuelea=system.Quelea, QueleaNetwork=system.QueleaNetwork, VisionRadiusMultiplier=1, VisionAngleMultiplier=1)
contain = ContainForce(Apply=True, WeightMultiplier=1, AgentQuelea=system.Quelea, Environment=aaboxenv, VisionRadiusMutliplier=number_slider_5)  # -> Force, DesiredVelocity
avoidobstacle = AvoidObstacleForce(Apply=True, WeightMultiplier=1, AgentQuelea=system.Quelea, Obstacle=cluster_11, VisionRadiusMutliplier=number_slider_6)  # -> Force, DesiredVelocity

data_4 = Data(cluster_2.number_of_users)
data_5 = Data(box)
pop3d_2 = Populate3D(Region=data_5, Count=number_slider_2, Seed=1)
vec_2 = VectorXYZ(XComponent=0, YComponent=0, ZComponent=0)  # -> Vector, Length
cluster_13 = Cluster_2(A=cluster_2.weight)
particle_2 = ConstructParticle(
    UpDirection=Vector(0, 0, 1),
    Acceleration=Vector(0, 0, 0),
    Lifespan=data,
    Mass=cluster_2.weight,
    BodySize=1,
    HistoryLength=1)
ptemit_2 = PointEmitter(
    ContinuousFlow=True,
    CreationRate=1,
    NumberOfQuelea=number_slider_2,
    MinimumInitialVelocity=vec_2.Vector,
    MaximumInitialVelocity=vec_2.Vector,
    Point=pop3d_2)
agent_2 = ConstructAgent(ParticleQueleaSettings=particle_2, MaxSpeed=0.5, MaxForce=0.1, VisionRadius=Slider(35, range=0..100), VisionAngle=360)
number_slider_7 = Slider(0.1, range=0..0.1)
aaboxenv_2 = AxisAlignedBoxEnvironment(Box=data_5)
system_2 = System(QueleaSettings=agent_2, Emitters=ptemit_2, Environment=aaboxenv_2)  # -> System, Quelea, QueleaNetwork
engine_2 = Engine(Reset=toggle, System=system_2.System)
neighbors_3 = GetNeighborsInRadius(AgentQuelea=system_2.Quelea, QueleaNetwork=system_2.QueleaNetwork, VisionRadiusMultiplier=1, VisionAngleMultiplier=1)
division_2 = Division(A=cluster_2.weight, B=10)
departicle_2 = DeconstructParticle(ParticleQuelea=system_2.Quelea)  # -> Position, Velocity, Acceleration, Lifespan, SurfacePosition, SurfaceVelocity, SurfaceAcceleration
pt_2 = Point(departicle_2.Position)
cohese_2 = CoheseForce(Apply=True, WeightMultiplier=1, AgentQuelea=system_2.Quelea, QueleaNetwork=neighbors_3)  # -> Force, DesiredVelocity

box_maker_2 = BoxMaker(B=pt_2, x=cluster_2.weight)
eh_ehe_2 = EhEhe(G=box_maker_2)
cluster_14 = Cluster_3(Q=system_2.Quelea, qn=system_2.QueleaNetwork)  # -> Q_2, qn_2
neighbors_4 = GetNeighborsInRadius(AgentQuelea=system_2.Quelea, QueleaNetwork=system_2.QueleaNetwork, VisionRadiusMultiplier=1, VisionAngleMultiplier=1)
contain_2 = ContainForce(
    Apply=True,
    WeightMultiplier=1,
    AgentQuelea=system_2.Quelea,
    Environment=aaboxenv_2,
    VisionRadiusMutliplier=number_slider_5)  # -> Force, DesiredVelocity
avoidobstacle_2 = AvoidObstacleForce(Apply=True, WeightMultiplier=1, AgentQuelea=system_2.Quelea, Obstacle=cluster_11, VisionRadiusMutliplier=number_slider_6)  # -> Force, DesiredVelocity

data_6 = Data(cluster_3.number_of_users)
data_7 = Data(box)
pop3d_3 = Populate3D(Region=data_7, Count=data_6, Seed=Slider(3, range=0..10))
vec_3 = VectorXYZ(XComponent=0, YComponent=0, ZComponent=0)  # -> Vector, Length
particle_3 = ConstructParticle(
    UpDirection=Vector(0, 0, 1),
    Acceleration=Vector(0, 0, 0),
    Lifespan=data,
    Mass=cluster_3.weight,
    BodySize=1,
    HistoryLength=1)
ptemit_3 = PointEmitter(
    ContinuousFlow=True,
    CreationRate=1,
    NumberOfQuelea=data_6,
    MinimumInitialVelocity=vec_3.Vector,
    MaximumInitialVelocity=vec_3.Vector,
    Point=pop3d_3)
agent_3 = ConstructAgent(ParticleQueleaSettings=particle_3, MaxSpeed=0.5, MaxForce=0.1, VisionRadius=Slider(35, range=0..100), VisionAngle=360)
number_slider_8 = Slider(0.1, range=0..0.1)
aaboxenv_3 = AxisAlignedBoxEnvironment(Box=data_7)
system_3 = System(QueleaSettings=agent_3, Emitters=ptemit_3, Environment=aaboxenv_3)  # -> System, Quelea, QueleaNetwork
engine_3 = Engine(Reset=toggle, System=system_3.System)
division_3 = Division(A=cluster_3.weight, B=10)
neighbors_5 = GetNeighborsInRadius(AgentQuelea=system_3.Quelea, QueleaNetwork=system_3.QueleaNetwork, VisionRadiusMultiplier=1, VisionAngleMultiplier=1)
departicle_3 = DeconstructParticle(ParticleQuelea=system_3.Quelea)  # -> Position, Velocity, Acceleration, Lifespan, SurfacePosition, SurfaceVelocity, SurfaceAcceleration
cohese_3 = CoheseForce(Apply=True, WeightMultiplier=1, AgentQuelea=system_3.Quelea, QueleaNetwork=neighbors_5)  # -> Force, DesiredVelocity
pt_3 = Point(departicle_3.Position)
cluster_15 = Cluster_2(A=cluster_3.weight)

cluster_16 = Cluster_3(Q=system_3.Quelea, qn=system_3.QueleaNetwork)  # -> Q_2, qn_2
box_maker_3 = BoxMaker(B=pt_3, x=cluster_3.weight)
eh_ehe_3 = EhEhe(G=box_maker_3)
neighbors_6 = GetNeighborsInRadius(AgentQuelea=system_3.Quelea, QueleaNetwork=system_3.QueleaNetwork, VisionRadiusMultiplier=1, VisionAngleMultiplier=1)
neighbors_7 = GetNeighborsInRadius(
    AgentQuelea=system_3.Quelea,
    QueleaNetwork=system_3.QueleaNetwork,
    VisionRadiusMultiplier=Slider(0.2, range=0..1),
    VisionAngleMultiplier=1)
contain_3 = ContainForce(
    Apply=True,
    WeightMultiplier=1,
    AgentQuelea=system_3.Quelea,
    Environment=aaboxenv_3,
    VisionRadiusMutliplier=number_slider_5)  # -> Force, DesiredVelocity
avoidobstacle_3 = AvoidObstacleForce(Apply=True, WeightMultiplier=1, AgentQuelea=system_3.Quelea, Obstacle=cluster_11, VisionRadiusMutliplier=number_slider_6)  # -> Force, DesiredVelocity

data_8 = Data(box)
data_9 = Data(cluster_5.number_of_users)
pop3d_4 = Populate3D(Region=data_8, Count=addition, Seed=1)
vec_4 = VectorXYZ(XComponent=0, YComponent=0, ZComponent=0)  # -> Vector, Length
particle_4 = ConstructParticle(
    UpDirection=Vector(0, 0, 1),
    Acceleration=Vector(0, 0, 0),
    Lifespan=data,
    Mass=cluster_5.weight,
    BodySize=1,
    HistoryLength=1)
ptemit_4 = PointEmitter(
    ContinuousFlow=True,
    CreationRate=1,
    NumberOfQuelea=addition,
    MinimumInitialVelocity=vec_4.Vector,
    MaximumInitialVelocity=vec_4.Vector,
    Point=pop3d_4)
toggle_2 = BooleanToggle(True)
agent_4 = ConstructAgent(ParticleQueleaSettings=particle_4, MaxSpeed=0.5, MaxForce=0.1, VisionRadius=Slider(35, range=0..100), VisionAngle=360)
number_slider_9 = Slider(0.1, range=0..0.1)
aaboxenv_4 = AxisAlignedBoxEnvironment(Box=data_8)
system_4 = System(QueleaSettings=agent_4, Emitters=ptemit_4, Environment=aaboxenv_4)  # -> System, Quelea, QueleaNetwork
engine_4 = Engine(Reset=toggle, System=system_4.System)
neighbors_8 = GetNeighborsInRadius(AgentQuelea=system_4.Quelea, QueleaNetwork=system_4.QueleaNetwork, VisionRadiusMultiplier=1, VisionAngleMultiplier=1)
division_4 = Division(A=cluster_5.weight, B=10)
departicle_4 = DeconstructParticle(ParticleQuelea=system_4.Quelea)  # -> Position, Velocity, Acceleration, Lifespan, SurfacePosition, SurfaceVelocity, SurfaceAcceleration
pt_4 = Point(departicle_4.Position)
cohese_4 = CoheseForce(Apply=True, WeightMultiplier=1, AgentQuelea=system_4.Quelea, QueleaNetwork=neighbors_8)  # -> Force, DesiredVelocity
cluster_17 = Cluster_2(A=cluster_5.weight)

cluster_18 = Cluster_3(Q=system_4.Quelea, qn=system_4.QueleaNetwork)  # -> Q_2, qn_2
box_maker_4 = BoxMaker(B=pt_4, x=cluster_5.weight)
eh_ehe_4 = EhEhe(G=box_maker_4)
neighbors_9 = GetNeighborsInRadius(AgentQuelea=system_4.Quelea, QueleaNetwork=system_4.QueleaNetwork, VisionRadiusMultiplier=1, VisionAngleMultiplier=1)
contain_4 = ContainForce(
    Apply=True,
    WeightMultiplier=1,
    AgentQuelea=system_4.Quelea,
    Environment=aaboxenv_4,
    VisionRadiusMutliplier=number_slider_5)  # -> Force, DesiredVelocity
avoidobstacle_4 = AvoidObstacleForce(Apply=True, WeightMultiplier=1, AgentQuelea=system_4.Quelea, Obstacle=cluster_11, VisionRadiusMutliplier=number_slider_6)  # -> Force, DesiredVelocity

data_10 = Data(box)
data_11 = Data(cluster_6.number_of_users)
pop3d_5 = Populate3D(Region=data_10, Count=data_11, Seed=Slider(15, range=0..100))
vec_5 = VectorXYZ(XComponent=0, YComponent=0, ZComponent=0)  # -> Vector, Length
particle_5 = ConstructParticle(
    UpDirection=Vector(0, 0, 1),
    Acceleration=Vector(0, 0, 0),
    Lifespan=data,
    Mass=cluster_6.weight,
    BodySize=1,
    HistoryLength=1)
ptemit_5 = PointEmitter(
    ContinuousFlow=True,
    CreationRate=1,
    NumberOfQuelea=data_11,
    MinimumInitialVelocity=vec_5.Vector,
    MaximumInitialVelocity=vec_5.Vector,
    Point=pop3d_5)
agent_5 = ConstructAgent(ParticleQueleaSettings=particle_5, MaxSpeed=0.5, MaxForce=0.1, VisionRadius=Slider(35, range=0..100), VisionAngle=360)
number_slider_10 = Slider(0.1, range=0..0.1)
aaboxenv_5 = AxisAlignedBoxEnvironment(Box=data_10)
system_5 = System(QueleaSettings=agent_5, Emitters=ptemit_5, Environment=aaboxenv_5)  # -> System, Quelea, QueleaNetwork
engine_5 = Engine(Reset=toggle, System=system_5.System)
division_5 = Division(A=cluster_6.weight, B=10)
neighbors_10 = GetNeighborsInRadius(AgentQuelea=system_5.Quelea, QueleaNetwork=system_5.QueleaNetwork, VisionRadiusMultiplier=1, VisionAngleMultiplier=1)
departicle_5 = DeconstructParticle(ParticleQuelea=system_5.Quelea)  # -> Position, Velocity, Acceleration, Lifespan, SurfacePosition, SurfaceVelocity, SurfaceAcceleration
cluster_19 = Cluster_2(A=cluster_6.weight)
cohese_5 = CoheseForce(Apply=True, WeightMultiplier=1, AgentQuelea=system_5.Quelea, QueleaNetwork=neighbors_10)  # -> Force, DesiredVelocity
pt_5 = Point(departicle_5.Position)

cluster_20 = Cluster_3(Q=system_5.Quelea, qn=system_5.QueleaNetwork)  # -> Q_2, qn_2
neighbors_11 = GetNeighborsInRadius(
    AgentQuelea=system_5.Quelea,
    QueleaNetwork=system_5.QueleaNetwork,
    VisionRadiusMultiplier=Slider(0.2, range=0..1),
    VisionAngleMultiplier=1)
box_maker_5 = BoxMaker(B=pt_5, x=cluster_6.weight)
eh_ehe_5 = EhEhe(G=box_maker_5)
neighbors_12 = GetNeighborsInRadius(AgentQuelea=system_5.Quelea, QueleaNetwork=system_5.QueleaNetwork, VisionRadiusMultiplier=1, VisionAngleMultiplier=1)
contain_5 = ContainForce(
    Apply=True,
    WeightMultiplier=1,
    AgentQuelea=system_5.Quelea,
    Environment=aaboxenv_5,
    VisionRadiusMutliplier=number_slider_5)  # -> Force, DesiredVelocity
avoidobstacle_5 = AvoidObstacleForce(Apply=True, WeightMultiplier=1, AgentQuelea=system_5.Quelea, Obstacle=cluster_11, VisionRadiusMutliplier=number_slider_6)  # -> Force, DesiredVelocity

data_12 = Data(cluster_4.number_of_users)
data_13 = Data(box)
pop3d_6 = Populate3D(Region=data_13, Count=data_12, Seed=Slider(2, range=0..10))
vec_6 = VectorXYZ(XComponent=0, YComponent=0, ZComponent=0)  # -> Vector, Length
ptemit_6 = PointEmitter(
    ContinuousFlow=True,
    CreationRate=1,
    NumberOfQuelea=data_12,
    MinimumInitialVelocity=vec_6.Vector,
    MaximumInitialVelocity=vec_6.Vector,
    Point=pop3d_6)
particle_6 = ConstructParticle(
    UpDirection=Vector(0, 0, 1),
    Acceleration=Vector(0, 0, 0),
    Lifespan=data,
    Mass=cluster_4.weight,
    BodySize=1,
    HistoryLength=1)
agent_6 = ConstructAgent(ParticleQueleaSettings=particle_6, MaxSpeed=0.5, MaxForce=0.1, VisionRadius=Slider(35, range=0..100), VisionAngle=360)
aaboxenv_6 = AxisAlignedBoxEnvironment(Box=data_13)
system_6 = System(QueleaSettings=agent_6, Emitters=ptemit_6, Environment=aaboxenv_6)  # -> System, Quelea, QueleaNetwork
engine_6 = Engine(Reset=toggle, System=system_6.System)
division_6 = Division(A=cluster_4.weight, B=10)
neighbors_13 = GetNeighborsInRadius(AgentQuelea=system_6.Quelea, QueleaNetwork=system_6.QueleaNetwork, VisionRadiusMultiplier=1, VisionAngleMultiplier=1)
departicle_6 = DeconstructParticle(ParticleQuelea=system_6.Quelea)  # -> Position, Velocity, Acceleration, Lifespan, SurfacePosition, SurfaceVelocity, SurfaceAcceleration
pt_6 = Point(departicle_6.Position)
cohese_6 = CoheseForce(Apply=True, WeightMultiplier=1, AgentQuelea=system_6.Quelea, QueleaNetwork=neighbors_13)  # -> Force, DesiredVelocity
neighbors_14 = GetNeighborsInRadius(AgentQuelea=system_6.Quelea, QueleaNetwork=system_6.QueleaNetwork, VisionRadiusMultiplier=1, VisionAngleMultiplier=1)

box_maker_6 = BoxMaker(B=pt_6, x=cluster_4.weight)
cluster_21 = Cluster_3(Q=system_6.Quelea, qn=system_6.QueleaNetwork)  # -> Q_2, qn_2
eh_ehe_6 = EhEhe(G=box_maker_6)
neighbors_15 = GetNeighborsInRadius(
    AgentQuelea=system_6.Quelea,
    QueleaNetwork=system_6.QueleaNetwork,
    VisionRadiusMultiplier=Slider(0.2, range=0..1),
    VisionAngleMultiplier=1)
contain_6 = ContainForce(
    Apply=True,
    WeightMultiplier=1,
    AgentQuelea=system_6.Quelea,
    Environment=aaboxenv_6,
    VisionRadiusMutliplier=number_slider_5)  # -> Force, DesiredVelocity
avoidobstacle_6 = AvoidObstacleForce(Apply=True, WeightMultiplier=1, AgentQuelea=system_6.Quelea, Obstacle=cluster_11, VisionRadiusMutliplier=number_slider_6)  # -> Force, DesiredVelocity

data_14 = Data(box)
data_15 = Data(cluster_7.number_of_users)
pop3d_7 = Populate3D(Region=data_14, Count=data_15, Seed=Slider(7, range=0..10))
vec_7 = VectorXYZ(XComponent=0, YComponent=0, ZComponent=0)  # -> Vector, Length
particle_7 = ConstructParticle(
    UpDirection=Vector(0, 0, 1),
    Acceleration=Vector(0, 0, 0),
    Lifespan=data,
    Mass=cluster_7.weight,
    BodySize=1,
    HistoryLength=1)
ptemit_7 = PointEmitter(
    ContinuousFlow=True,
    CreationRate=1,
    NumberOfQuelea=data_15,
    MinimumInitialVelocity=vec_7.Vector,
    MaximumInitialVelocity=vec_7.Vector,
    Point=pop3d_7)
toggle_3 = BooleanToggle(True)
agent_7 = ConstructAgent(ParticleQueleaSettings=particle_7, MaxSpeed=0.5, MaxForce=0.1, VisionRadius=Slider(35, range=0..100), VisionAngle=360)
number_slider_11 = Slider(0.1, range=0..0.1)
aaboxenv_7 = AxisAlignedBoxEnvironment(Box=data_14)
system_7 = System(QueleaSettings=agent_7, Emitters=ptemit_7, Environment=aaboxenv_7)  # -> System, Quelea, QueleaNetwork
engine_7 = Engine(Reset=toggle, System=system_7.System)
division_7 = Division(A=cluster_7.weight, B=10)
neighbors_16 = GetNeighborsInRadius(AgentQuelea=system_7.Quelea, QueleaNetwork=system_7.QueleaNetwork, VisionRadiusMultiplier=1, VisionAngleMultiplier=1)
departicle_7 = DeconstructParticle(ParticleQuelea=system_7.Quelea)  # -> Position, Velocity, Acceleration, Lifespan, SurfacePosition, SurfaceVelocity, SurfaceAcceleration
pt_7 = Point(departicle_7.Position)
cohese_7 = CoheseForce(Apply=True, WeightMultiplier=1, AgentQuelea=system_7.Quelea, QueleaNetwork=neighbors_16)  # -> Force, DesiredVelocity
cluster_22 = Cluster_2(A=cluster_7.weight)
separate = SeparateForce(
    Apply=True,
    WeightMultiplier=0.5,
    AgentQuelea=system_7.Quelea,
    QueleaNetwork=[neighbors_6, neighbors_14, neighbors_9, neighbors_12, neighbors_2, neighbors_4])  # -> Force, DesiredVelocity

box_maker_7 = BoxMaker(B=pt_7, x=cluster_7.weight)
cluster_23 = Cluster_3(Q=system_7.Quelea, qn=system_7.QueleaNetwork)  # -> Q_2, qn_2
eh_ehe_7 = EhEhe(G=box_maker_7)
neighbors_17 = GetNeighborsInRadius(
    AgentQuelea=system_7.Quelea,
    QueleaNetwork=system_7.QueleaNetwork,
    VisionRadiusMultiplier=Slider(0.2, range=0..1),
    VisionAngleMultiplier=1)

preview_2 = CustomPreview(Geometry=eh_ehe_3, Material=ColourSwatch(SwatchColor=RGB(212, 23, 139)))
avoidobstacle_7 = AvoidObstacleForce(
    Apply=True,
    WeightMultiplier=1,
    AgentQuelea=system_3.Quelea,
    Obstacle=graft(box_maker_3),
    VisionRadiusMutliplier=Slider(0.2, range=0..1))  # -> Force, DesiredVelocity
separate_2 = SeparateForce(
    Apply=True,
    WeightMultiplier=0.5,
    AgentQuelea=system_3.Quelea,
    QueleaNetwork=[neighbors_9, neighbors_2, neighbors_4, neighbors_15, neighbors_17, neighbors_11])  # -> Force, DesiredVelocity

neighbors_18 = GetNeighborsInRadius(AgentQuelea=system_7.Quelea, QueleaNetwork=system_7.QueleaNetwork, VisionRadiusMultiplier=1, VisionAngleMultiplier=1)

avoidobstacle_8 = AvoidObstacleForce(
    Apply=True,
    WeightMultiplier=number_slider_4,
    AgentQuelea=system_4.Quelea,
    Obstacle=box_maker_4,
    VisionRadiusMutliplier=Slider(0.2, range=0..1))  # -> Force, DesiredVelocity
preview_3 = CustomPreview(Geometry=eh_ehe_4, Material=ColourSwatch(SwatchColor=RGB(242, 56, 56)))
separate_3 = SeparateForce(
    Apply=True,
    WeightMultiplier=0.5,
    AgentQuelea=system_4.Quelea,
    QueleaNetwork=[neighbors_14, neighbors_6, neighbors_4, neighbors_2, neighbors_18, neighbors_12])  # -> Force, DesiredVelocity

preview_4 = CustomPreview(Geometry=eh_ehe, Material=ColourSwatch(SwatchColor=RGB(78, 163, 163)))
avoidobstacle_9 = AvoidObstacleForce(
    Apply=True,
    WeightMultiplier=number_slider_4,
    AgentQuelea=system.Quelea,
    Obstacle=box_maker,
    VisionRadiusMutliplier=Slider(0.1, range=0..1))  # -> Force, DesiredVelocity
separate_4 = SeparateForce(
    Apply=True,
    WeightMultiplier=expr("1-(x/10)", cluster.weight),
    AgentQuelea=system.Quelea,
    QueleaNetwork=[neighbors_9, neighbors_18, neighbors_4, neighbors_11, neighbors_17, neighbors_7, neighbors_15])  # -> Force, DesiredVelocity

preview_5 = CustomPreview(Geometry=eh_ehe_6, Material=ColourSwatch(SwatchColor=RGB(78, 163, 163)))
avoidobstacle_10 = AvoidObstacleForce(
    Apply=True,
    WeightMultiplier=number_slider_4,
    AgentQuelea=system_6.Quelea,
    Obstacle=box_maker_6,
    VisionRadiusMutliplier=Slider(0.2, range=0..1))  # -> Force, DesiredVelocity
separate_5 = SeparateForce(
    Apply=True,
    WeightMultiplier=Slider(0.7, range=0..1),
    AgentQuelea=system_6.Quelea,
    QueleaNetwork=[neighbors_9, neighbors_2, neighbors_4, neighbors_17, neighbors_11, neighbors_7])  # -> Force, DesiredVelocity

avoidobstacle_11 = AvoidObstacleForce(
    Apply=True,
    WeightMultiplier=1,
    AgentQuelea=system_2.Quelea,
    Obstacle=box_maker_2,
    VisionRadiusMutliplier=Slider(0.2, range=0..1))  # -> Force, DesiredVelocity
preview_6 = CustomPreview(Geometry=eh_ehe_2, Material=ColourSwatch(SwatchColor=RGB(255, 187, 0)))
separate_6 = SeparateForce(
    Apply=True,
    WeightMultiplier=Slider(0.2, range=0..1),
    AgentQuelea=system_2.Quelea,
    QueleaNetwork=[neighbors_9, neighbors_14, neighbors_6, neighbors_18, neighbors_12])  # -> Force, DesiredVelocity

avoidobstacle_12 = AvoidObstacleForce(
    Apply=True,
    WeightMultiplier=number_slider_4,
    AgentQuelea=system_5.Quelea,
    Obstacle=box_maker_5,
    VisionRadiusMutliplier=Slider(0.3, range=0..1))  # -> Force, DesiredVelocity
preview_7 = CustomPreview(Geometry=eh_ehe_5, Material=ColourSwatch(SwatchColor=RGB(22, 20, 61)))
separate_7 = SeparateForce(
    Apply=True,
    WeightMultiplier=cluster_19,
    AgentQuelea=system_5.Quelea,
    QueleaNetwork=[neighbors_9, neighbors_14, neighbors_6, neighbors_18, neighbors_2, neighbors_4, neighbors_15])  # -> Force, DesiredVelocity

avoidobstacle_13 = AvoidObstacleForce(
    Apply=True,
    WeightMultiplier=1,
    AgentQuelea=system_7.Quelea,
    Obstacle=graft(box_maker_7),
    VisionRadiusMutliplier=Slider(0.1, range=0..1))  # -> Force, DesiredVelocity
preview_8 = CustomPreview(Geometry=eh_ehe_7, Material=ColourSwatch(SwatchColor=RGB(78, 163, 87)))

all_obstacle = Data([box_maker_6, box_maker_3, box_maker_7, box_maker_5, box_maker, box_maker_2, box_maker_4])
area = Area(Geometry=all_obstacle)  # -> Area, Centroid
scale = Scale(Geometry=all_obstacle, Center=area.Centroid, Factor=Slider(1.5, range=0..10))  # -> Geometry, Transform
contain_7 = ContainForce(
    Apply=True,
    WeightMultiplier=1,
    AgentQuelea=system_7.Quelea,
    Environment=aaboxenv_7,
    VisionRadiusMutliplier=Slider(0.24, range=0..1))  # -> Force, DesiredVelocity
avoidobstacle_14 = AvoidObstacleForce(Apply=True, WeightMultiplier=1, AgentQuelea=system_7.Quelea, Obstacle=cluster_11, VisionRadiusMutliplier=number_slider_6)  # -> Force, DesiredVelocity

# ==== cluster Cluster
L = ClusterInput()
i = ClusterInput()
item = ListItem(List=L, Index=i, Wrap=True)  # -> flatten(Item)
item_2 = ListItem(List=item, Index=0, Wrap=True)
number_of_people = ListItem(List=item, Index=2, Wrap=True)
item_3 = ListItem(List=item, Index=5, Wrap=True)
all_output = ClusterOutput(item)
number_of_users = ClusterOutput(number_of_people)
weight = ClusterOutput(item_3)
program_neme = ClusterOutput(item_2)

# ==== cluster Cluster_2
A = ClusterInput()
multiplication = Multiplication(A=A, B=Slider(0.1, range=0..0.1))
subtraction = Subtraction(A=1, B=multiplication)
R = ClusterOutput(subtraction)

# ==== cluster Cluster_3
Q = ClusterInput()
qn = ClusterInput()
data = Data(Q)
data_2 = Data(qn)
Q_2 = ClusterOutput(data)
qn_2 = ClusterOutput(data_2)

# ==== cluster BoxMaker
x = ClusterInput()
division = Division(A=1, B=3)
eval = Evaluate(F="x^y", x=x, y=division)
B = ClusterInput()
box = CenterBox(Base=B, X=eval, Y=eval, Z=eval)
B_2 = ClusterOutput(box)

# ==== cluster Cluster_4
A = ClusterInput()
division = Division(A=A, B=10)
subtraction = Subtraction(A=1, B=division)
R = ClusterOutput(subtraction)

# ==== cluster EhEhe
G = ClusterInput()
volume = Volume(Geometry=G)  # -> Volume, Centroid
scale = Scale(Geometry=G, Center=volume.Centroid, Factor=Slider(0.5, range=0..1))  # -> Geometry, Transform
G_2 = ClusterOutput(scale.Geometry)

# ==== cluster Cluster_5

crv = Curve([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])
pipe = Pipe(Curve=crv, Radius=Slider(2, range=0..10), Caps=0)

P = ClusterOutput(pipe)
