# Grasshopper definition TokyoHotel_PB_Architecture.gh (Grasshopper 1.0.5)
# plug-ins: Pufferfish, Human, FalseStartToggle, MetaHopper

scribbles = GetScribbles()  # -> Scribbles, ScribbleText, ScribblePlane, ScribbleSize
panel = Panel(scribbles.ScribbleSize)
panel_2 = Panel(scribbles.ScribbleText)
box = CenterBox(Base=PlaneXY(0, 0, 0), X=Slider(117, range=0..1000), Y=Slider(73, range=0..1000), Z=Slider(119, range=0..1000))

# ---- group: generator
# SITE BOUNDRY
number_slider = Slider(150, range=0..1000)
box_2 = CenterBox(Base=PlaneXY(0, 0, 0), X=Slider(200, range=0..1000), Y=number_slider, Z=Slider(150, range=0..1000))
preview = CustomPreview(Geometry=box_2, Material=ColourSwatch(SwatchColor=RGBA(0, 0, 0, 70)))

# ----
number_slider_2 = Slider(25, range=0..1000)
layertable = LayerTable(Update=Toggle(True), AutoUpdate=False)  # -> Layers, FullLayerPaths, LayerColors, Linetypes, MaterialNames, Visible, PrintWidth, PrintColor
panel_3 = Panel(layertable.Layers)
number_slider_3 = Slider(12, range=0..100)
galapagos = Galapagos(fitness=ma, gene=number_slider_3)
number_slider_4 = Slider(0.15, range=0..1)

# ---- group: generator
# pleasure block
number_slider_5 = Slider(1, range=0..1000)
pop3d = Populate3D(Region=box, Count=number_slider_5, Seed=Slider(14, range=0..100))
box_3 = CenterBox(Base=pop3d, X=Slider(95, range=0..1000), Y=Slider(95, range=0..1000), Z=Slider(20, range=0..1000))

# ----
box_4 = CenterBox(Base=pop3d, X=Slider(105, range=0..1000), Y=Slider(105, range=0..1000), Z=number_slider_2)

# ---- group: generator (continued)
preview_2 = CustomPreview(Geometry=box_4, Material=ColourSwatch(SwatchColor=RGBA(150, 163, 162, 65)))

# ---- group: switches
# right click to enable
# 1
toggle = GroupToggle(ToggleActive=True, ToggleVisible=False)  # disabled
debrep = DeconstructBrep(Brep=box_4)  # -> Faces, Edges, Vertices; disabled

# ---- group: generator
# room explosion
number_slider_6 = Slider(70, range=0..1000)
pop3d_2 = Populate3D(Region=box_3, Count=number_slider_6, Seed=Slider(0, range=0..100))

# ----
debrep_2 = DeconstructBrep(Brep=box_4)  # -> Faces, Edges, Vertices

toggle_2 = FalseStartToggle(False)
item = ListItem(List=layertable.Layers, Index=Slider(6, range=0..10), Wrap=True)
panel_4 = Panel(item)
hideshow = HideShowObjectPreview(Visible=Toggle(False), AllObjects_Object=preview_7)

cluster = Cluster(lay=item)

bake = BakeObject(ObjectAttributes=cluster, Bake=toggle_2, AllObjects_Object=preview_7)

toggle_3 = FalseStartToggle(False)
item_2 = ListItem(List=layertable.Layers, Index=Slider(0, range=0..10), Wrap=True)
panel_5 = Panel(item_2)
hideshow_2 = HideShowObjectPreview(Visible=Toggle(False), AllObjects_Object=[preview_3, preview_5, preview_4])

cluster_2 = Cluster(lay=item_2)

bake_2 = BakeObject(ObjectAttributes=cluster_2, Bake=toggle_3, AllObjects_Object=[preview_3, preview_5, preview_4])

toggle_4 = FalseStartToggle(False)
item_3 = ListItem(List=layertable.Layers, Index=Slider(1, range=0..10), Wrap=True)
panel_6 = Panel(item_3)
hideshow_3 = HideShowObjectPreview(Visible=Toggle(False), AllObjects_Object=preview_6)

cluster_3 = Cluster(lay=item_3)

bake_3 = BakeObject(ObjectAttributes=cluster_3, Bake=toggle_4, AllObjects_Object=preview_6)

toggle_5 = FalseStartToggle(False)
# JAPAN , TOKYO
# WARNING !
# DISABLE ALL RED DISTRICT
# BEFOR ANY SAVE OR BIG CACULATION
item_4 = ListItem(List=layertable.Layers, Index=Slider(3, range=0..10), Wrap=True)
panel_7 = Panel(item_4)
hideshow_4 = HideShowObjectPreview(Visible=Toggle(False), AllObjects_Object=preview_8)

cluster_4 = Cluster(lay=item_4)

bake_4 = BakeObject(ObjectAttributes=cluster_4, Bake=toggle_5, AllObjects_Object=preview_8)

# ----
# seeds can effect our whole
# pleasure box
# it can generate by galapagus
# triple rooms
triple_rooms = Slider(6, range=0..100)
dom = ConstructDomain(DomainStart=Slider(1, range=0..10), DomainEnd=Slider(99, range=0..100))
random = Random(Range=dom, Number=triple_rooms, Seed=Slider(20, range=0..100))

toggle_6 = FalseStartToggle(False)
item_5 = ListItem(List=layertable.Layers, Index=Slider(4, range=0..10), Wrap=True)
panel_8 = Panel(item_5)
hideshow_5 = HideShowObjectPreview(Visible=Toggle(False), AllObjects_Object=preview_2)

cluster_5 = Cluster(lay=item_5)

bake_5 = BakeObject(ObjectAttributes=cluster_5, Bake=toggle_6, AllObjects_Object=preview_2)

toggle_7 = FalseStartToggle(False)
# BAKERY
toggle_8 = BooleanToggle(False)
item_6 = ListItem(List=layertable.Layers, Index=Slider(5, range=0..10), Wrap=True)
panel_9 = Panel(item_6)
hideshow_6 = HideShowObjectPreview(Visible=toggle_8, AllObjects_Object=preview)

cluster_6 = Cluster(lay=item_6)

bake_6 = BakeObject(ObjectAttributes=cluster_6, Bake=toggle_7, AllObjects_Object=preview)

# ----
# double rooms
seeds = Slider(30, range=0..100)
double_rooms = Slider(20, range=0..100)
dom_2 = ConstructDomain(DomainStart=Slider(1, range=0..10), DomainEnd=Slider(99, range=0..100))
random_2 = Random(Range=dom_2, Number=double_rooms, Seed=seeds)
item_7 = ListItem(List=pop3d_2, Index=random_2, Wrap=True)

cull_i = CullIndex(List=pop3d_2, Indices=random_2, Wrap=True)
item_8 = ListItem(List=cull_i, Index=random, Wrap=True)

# ---- group: switches
# right click to enable
#                                 2
toggle_9 = GroupToggle(ToggleActive=True, ToggleVisible=False)  # disabled

# ---- group: generator
# hotel room
number_slider_7 = Slider(4, range=0..100)
number_slider_8 = Slider(10, range=0..100)
number_slider_9 = Slider(2, range=0..100)

# ----
neg = Negative(Value=number_slider_7)
X = UnitX(Factor=number_slider_7)
move = Move(Geometry=item_8, Motion=X)  # -> Geometry, Transform

X_2 = UnitX(Factor=neg)

X_3 = UnitX(Factor=number_slider_7)
move_2 = Move(Geometry=item_7, Motion=X_3)  # -> Geometry, Transform

move_3 = Move(Geometry=item_8, Motion=X_2)  # -> Geometry, Transform

# ---- group: switches (continued)
relay = Relay([pop3d_2, move_2.Geometry, move.Geometry, move_3.Geometry])  # disabled

# ----
division = Division(A=number_slider_9, B=2)
Z = UnitZ(Factor=division)
neg_2 = Negative(Value=Z)
move_4 = Move(Geometry=pop3d_2, Motion=neg_2)  # -> Geometry, Transform

# ---- group: generator (continued)
box_5 = CenterBox(Base=relay, X=expr("x/2", number_slider_7), Y=expr("x/2", number_slider_8), Z=expr("x/2", number_slider_9))
debrep_3 = DeconstructBrep(Brep=box_5)  # -> Faces, Edges, Vertices
item_9 = ListItem(List=debrep_3.Faces, Index=Slider(3, range=0..10), Wrap=True)
item_10 = ListItem(List=debrep_3.Faces, Index=Slider(4, range=0..10), Wrap=True)
item_11 = ListItem(List=debrep_3.Faces, Index=Slider(7, range=0..10), Wrap=True)
join = BrepJoin(Breps=[item_9, item_10, item_11])  # -> Breps, Closed

# ----
data = Data(move_4.Geometry)

# ---- group: generator
# piping
# bottom
number_slider_10 = Slider(4, range=0..10)
item_12 = ListItem(List=debrep.Faces, Index=number_slider_10, Wrap=True)
srf_cp = SurfaceClosestPoint(Point=data, Surface=item_12)  # -> Point, UVPoint, Distance
ln = Line(StartPoint=srf_cp.Point, EndPoint=data)
pipe = Pipe(Curve=ln, Radius=number_slider_4, Caps=0)
preview_3 = CustomPreview(Geometry=pipe, Material=ColourSwatch(SwatchColor=RGBA(208, 255, 54, 162)))

# front
number_slider_11 = Slider(2, range=0..10)
item_13 = ListItem(List=debrep.Faces, Index=number_slider_11, Wrap=True)
srf_cp_2 = SurfaceClosestPoint(Point=data, Surface=item_13)  # -> Point, UVPoint, Distance
ln_2 = Line(StartPoint=srf_cp_2.Point, EndPoint=data)
pipe_2 = Pipe(Curve=ln_2, Radius=number_slider_4, Caps=0)
preview_4 = CustomPreview(Geometry=pipe_2, Material=ColourSwatch(SwatchColor=RGBA(208, 255, 54, 162)))

# right
number_slider_12 = Slider(3, range=0..10)
item_14 = ListItem(List=debrep.Faces, Index=number_slider_12, Wrap=True)
srf_cp_3 = SurfaceClosestPoint(Point=data, Surface=item_14)  # -> Point, UVPoint, Distance
ln_3 = Line(StartPoint=srf_cp_3.Point, EndPoint=data)
pipe_3 = Pipe(Curve=ln_3, Radius=number_slider_4, Caps=0)
preview_5 = CustomPreview(Geometry=pipe_3, Material=ColourSwatch(SwatchColor=RGBA(208, 255, 54, 162)))

# roof
item_15 = ListItem(List=debrep_3.Vertices, Index=4, Wrap=True)
item_16 = ListItem(List=debrep_3.Vertices, Index=5, Wrap=True)
item_17 = ListItem(List=debrep_3.Vertices, Index=7, Wrap=True)
item_18 = ListItem(List=debrep_3.Vertices, Index=6, Wrap=True)
ln_4 = Line(StartPoint=item_17, EndPoint=item_18)
ln_5 = Line(StartPoint=item_16, EndPoint=item_15)
roof_height = Slider(2, range=0..10)
Z_2 = UnitZ(Factor=roof_height)
Z_3 = UnitZ(Factor=roof_height)
end = EndPoints(Curve=ln_5)  # -> Start, End
Y = UnitY(Factor=number_slider_8)

# ----
eval = EvaluateCurve(Curve=reparameterize(ln_4), Parameter=0.5)  # -> Point, Tangent, Angle
eval_2 = EvaluateCurve(Curve=reparameterize(ln_5), Parameter=0.5)  # -> Point, Tangent, Angle

# ---- group: generator (continued)
move_5 = Move(Geometry=eval_2.Point, Motion=Z_2)  # -> Geometry, Transform
move_6 = Move(Geometry=eval.Point, Motion=Z_3)  # -> Geometry, Transform
pline = PolyLine(Vertices=[end.Start, move_5.Geometry, end.End], Closed=False)
extr = Extrude(Base=pline, Direction=Y)

# ---- group: switches
# right click to enable
#             3
toggle_10 = GroupToggle(ToggleActive=True, ToggleVisible=False)  # disabled
data_2 = Data([join.Breps, extr])  # disabled

# ---- group: generator
# THICKNESS
join_2 = BrepJoin(Breps=data_2)  # -> Breps, Closed
neg_3 = Negative(Value=Slider(0.2, range=0..1))
offsrf = OffsetSurface(Surface=join_2.Breps, Distance=neg_3, BothSides=False, CreateSolid=True)
preview_6 = CustomPreview(Geometry=offsrf, Material=ColourSwatch(SwatchColor=RGB(255, 143, 143)))

# ----
# columns
number_slider_13 = Slider(4, range=0..10)
item_19 = ListItem(List=debrep_2.Faces, Index=number_slider_13, Wrap=True)
srf_cp_4 = SurfaceClosestPoint(Point=relay, Surface=item_19)  # -> Point, UVPoint, Distance
multiplication = Multiplication(A=number_slider_2, B=2)
popgeo = PopulateGeometry(Geometry=item_19, Count=Slider(6, range=0..10), Seed=number_slider_3, Points=srf_cp_4.Point)
neg_4 = Negative(Value=Slider(0.2, range=0..1))

# ----
# room access
# only for one block
number_slider_14 = Slider(0, range=0..10)
neg_5 = Negative(Value=number_slider_14)
Z_4 = UnitZ(Factor=multiplication)
Z_5 = UnitZ(Factor=neg_5)
pt = Point(pop3d_2)
move_7 = Move(Geometry=popgeo, Motion=Z_4)  # -> Geometry, Transform
move_8 = Move(Geometry=pt, Motion=Z_5)  # -> Geometry, Transform
ln_6 = Line(StartPoint=move_7.Geometry, EndPoint=popgeo)
flip = FlipMatrix(Data=ln_6)
flip_2 = FlipMatrix(Data=move_8.Geometry)
item_20 = ListItem(List=flip, Index=0, Wrap=True)
item_21 = ListItem(List=flip_2, Index=0, Wrap=True)
crv_cp = CurveClosestPoint(Point=flatten(item_21), Curve=item_20)  # -> Point, Parameter, Distance
dist = Distance(PointA=flatten(item_21), PointB=crv_cp.Point)
ln_7 = Line(StartPoint=flatten(item_21), EndPoint=crv_cp.Point)
flip_3 = FlipMatrix(Data=dist)
flip_4 = FlipMatrix(Data=ln_7)
hilo = HighestLowestNumbers(Numbers=flip_4)  # -> Highest, Lowest
panel_10 = Panel(flip_3)
panel_11 = Panel(hilo.Lowest)
fsim = FindSimilarMember(Data=flip_3, Set=panel_11)  # -> Hit, Index
panel_12 = Panel(fsim.Hit)
equals = Equality(FirstNumber=panel_12, SecondNumber=panel_10)  # -> Equality, Inequality
cull = CullPattern(List=flip_4, CullPattern=equals.Equality)

pipe_4 = Pipe(Curve=ln_6, Radius=Slider(3, range=0..10), Caps=0)
offsrf_2 = OffsetSurface(Surface=pipe_4, Distance=neg_4, BothSides=False, CreateSolid=True)
preview_7 = CustomPreview(Geometry=offsrf_2, Material=ColourSwatch(SwatchColor=RGB(255, 5, 5)))

len = Length(Curve=cull)  # -> flatten(Length)

# ---- group: generator
# surface for access
# ABOUT access dividing spaces ()
# create main program in space... we need new defenition in grasshopper that work with the past defenition
number_slider_15 = Slider(2, range=0..10)
amp = Amplitude(Vector=cull, Amplitude=number_slider_15)
rotate = Rotate(Geometry=amp, Angle=degrees("90"), Plane=PlaneXY(0, 0, 0))  # -> Geometry, Transform
rotate_2 = Rotate(Geometry=amp, Angle=degrees("-90"), Plane=PlaneXY(0, 0, 0))  # -> Geometry, Transform
extr_2 = Extrude(Base=cull, Direction=[rotate.Geometry, rotate_2.Geometry])
neg_6 = Negative(Value=Slider(2, range=0..10))
Z_6 = UnitZ(Factor=neg_6)
move_9 = Move(Geometry=extr_2, Motion=Z_6)  # -> Geometry, Transform
Z_7 = UnitZ(Factor=Slider(0.5, range=0..1))
cap = CapHoles(Brep=pipe_4)
extr_3 = Extrude(Base=move_9.Geometry, Direction=Z_7)
trim = TrimSolid(Shape=flatten(extr_3), Cutters=flatten(cap))
preview_8 = CustomPreview(Geometry=trim, Material=ColourSwatch(SwatchColor=RGB(102, 74, 74)))

# ----
ma = MassAddition(Input=len)  # -> Result, PartialResults
panel_13 = Panel(ma.Result)

# ==== cluster Cluster
lay = ClusterInput()
createatts = CreateAttributes(LayerName=lay, enableFullPath=False)
att = ClusterOutput(createatts)
